# Grasshopper definition PterodactylTests.gh (Grasshopper 1.0.7)
# plug-ins: Brontosaurus, Pterodactyl

calendar = Calendar()
# Format
# Parts
# Report
# Tools
panel = Panel("Test")
strong = Strong(Text="Test")
emphasis = Emphasis(Text=panel)
strike = Strike(Text="Test")
underline = Underline(Text="Test")
txt = Text("**Test**")
txt_2 = Text("*Test*")
txt_3 = Text("~~Test~~")
# File path to directory with test files
panel_2 = Panel("C:\Users\pc\RiderProjects\Pterodactyl\TestsInsideGrasshopper\")
txt_4 = Text("<u>Test</u>")
panel_3 = Panel(txt)
panel_4 = Panel(txt_2)
panel_5 = Panel(txt_3)
assert = Assert(TestNames="Strong", Expected=txt, Actual=strong)  # -> Result, FailedInfo
# Format
assert_2 = Assert(TestNames="Emphasis", Expected=txt_2, Actual=emphasis)  # -> Result, FailedInfo
assert_3 = Assert(TestNames="Strike", Expected=txt_3, Actual=strike)  # -> Result, FailedInfo
panel_6 = Panel(txt_4)
assert_4 = Assert(TestNames="Underline", Expected=txt_4, Actual=underline)  # -> Result, FailedInfo
entwine = Entwine(Branch00=assert_2.Result, Branch01=assert_3.Result, Branch02=assert.Result, Branch03=assert_4.Result, FlattenInputs=True)  # -> flatten(Result)
path = FilePath(panel_2)
concat = Concatenate(FragmentA=path, FragmentB="logo pterodactyl 100x100px.png")
concat_2 = Concatenate(FragmentA=path, FragmentB="Viewport.png")
panel_7 = Panel("""Content
Of
First
Heading""")
panel_8 = Panel("""Content
Of
Second
Heading""")
panel_9 = Panel("""Third
Heading
Content
!""")
panel_10 = Panel("""First item
Second item""")
panel_11 = Panel("""First task
Second task""")
panel_12 = Panel("""First item
Second item""")
panel_13 = Panel("""False
True""")
# Manually check if there is Viewport file correct
panel_14 = Panel("My viewport")
path_2 = FilePath(concat)
series = Series(Start=1, Step=1, Count=6)
panel_15 = Panel("""x
y""")
panel_16 = Panel("""45
30""")
panel_17 = Panel("""Heading 1
Heading 2
Heading 3""")
path_3 = FilePath(concat_2)
horizontal_line = HorizontalLine()
heading = Heading(Text="Test", Level=series)
entwine_2 = Entwine(Branch00=panel_7, Branch01=panel_8, Branch02=panel_9, FlattenInputs=True)
quote = Quote(Text="Test")
page_break = PageBreak()
unordered_list = UnorderedList(Items=panel_12)
ordered_list = OrderedList(Items=panel_10)
task_list = TaskList(Tasks=panel_11, Done=panel_13)
viewport = Viewport(
    Title=panel_14,
    ViewportName="Top",
    Path=path_3,
    DrawAxes=Toggle(True),
    DrawGrid=Toggle(True),
    DrawGridAxes=Toggle(True),
    TransparentBackground=Toggle(False))
image = Image(Title="Picture title", Path=path_2)
txt_5 = Text("------")
code_block = CodeBlock(ProgrammingLanguage="Python", Code="print(\"Hello world\")")
txt_6 = Text(["# Test", "## Test", "### Test", "#### Test", "##### Test", "###### Test"])
txt_7 = Text("[Test](www.google.com)")
txt_8 = Text("> Test")
txt_9 = Text("<div style=\"page-break-after: always;\"></div>")
panel_18 = Panel("""0
1
2""")
dynamic_math_block = DynamicMathBlock(Text="sin(<x>) + cos(<y>) = ?", VariablesSymbols=panel_15, VariablesValues=panel_16)
txt_10 = Text(["| Heading 1 | Heading 2 | Heading 3 |", "| --------- | :-------: | --------: |", "| Content   | Content   | Third     |", "| Of        | Of        | Heading   |", "| First     | Second    | Content   |", "| Heading   | Heading   | !         |"])
math_block = MathBlock(Text="sin(x) + cos(y) = ?")
txt_11 = Text("""1. First item
2. Second item""")
txt_12 = Text("""- [ ] First task
- [x] Second task""")
txt_13 = Text("""- First item
- Second item""")
panel_19 = Panel(txt_5)
panel_20 = Panel(txt_7)
assert_5 = Assert(TestNames="Horizontal Line", Expected=txt_5, Actual=horizontal_line)  # -> Result, FailedInfo
hyperlink = Hyperlink(Text="Test", Link="www.google.com")
panel_21 = Panel(txt_6)
panel_22 = Panel(txt_9)
panel_23 = Panel(txt_8)
assert_6 = Assert(TestNames="Page Break", Expected=txt_9, Actual=page_break)  # -> Result, FailedInfo
assert_7 = Assert(TestNames="Quote", Expected=txt_8, Actual=quote)  # -> Result, FailedInfo
table = Table(TableHeadings=panel_17, Alignment=panel_18, DataTree=entwine_2)
txt_14 = Text("""$$
sin(45) + cos(30) = ?
$$""")
# Parts
assert_list = AssertList(TestName="Heading", ExpectedList=txt_6, ActualList=heading)  # -> Result, FailedInfo
txt_15 = Text("""$$
sin(x) + cos(y) = ?
$$""")
panel_24 = Panel(txt_11)
panel_25 = Panel(txt_12)
panel_26 = Panel(txt_13)
txt_16 = Text("""```Python
print("Hello world")
```""")
panel_27 = Panel(txt_10)
txt_17 = Text("![Picture title](C:\Users\pc\RiderProjects\Pterodactyl\TestsInsideGrasshopper\logo pterodactyl 100x100px.png)")
assert_list_2 = AssertList(TestName="Ordered list", ExpectedList=txt_11, ActualList=ordered_list)  # -> Result, FailedInfo
assert_list_3 = AssertList(TestName="Unordered list", ExpectedList=txt_13, ActualList=unordered_list)  # -> Result, FailedInfo
txt_18 = Text("![My viewport](C:\Users\pc\RiderProjects\Pterodactyl\TestsInsideGrasshopper\Viewport.png)")
assert_list_4 = AssertList(TestName="Task list", ExpectedList=txt_12, ActualList=task_list)  # -> Result, FailedInfo
panel_28 = Panel(txt_14)
assert_8 = Assert(TestNames="Math Block", Expected=txt_15, Actual=math_block)  # -> Result, FailedInfo
panel_29 = Panel(txt_15)
panel_30 = Panel(txt_16)
assert_9 = Assert(TestNames="Image", Expected=txt_17, Actual=image)  # -> Result, FailedInfo
panel_31 = Panel(txt_17)
panel_32 = Panel(txt_18)
assert_10 = Assert(TestNames="Hyperlink", Expected=txt_7, Actual=hyperlink)  # -> Result, FailedInfo
assert_list_5 = AssertList(TestName="Code block", ExpectedList=txt_16, ActualList=code_block)  # -> Result, FailedInfo
assert_list_6 = AssertList(TestName="Dynamic Math Block", ExpectedList=txt_14, ActualList=dynamic_math_block)  # -> Result, FailedInfo
assert_11 = Assert(TestNames="Viewport", Expected=txt_18, Actual=viewport)  # -> Result, FailedInfo
assert_list_7 = AssertList(TestName="Table", ExpectedList=txt_10, ActualList=table)  # -> Result, FailedInfo
entwine_3 = Entwine(Branch00=assert_list_2.Result, Branch01=assert_list_4.Result, Branch02=assert_list_3.Result, FlattenInputs=True)  # -> flatten(Result)
entwine_4 = Entwine(
    Branch00=assert_list.Result,
    Branch01=assert_5.Result,
    Branch02=assert_10.Result,
    Branch03=assert_6.Result,
    Branch04=assert_7.Result,
    Branch05=assert_list_7.Result,
    FlattenInputs=True)  # -> flatten(Result)
entwine_5 = Entwine(Branch00=assert_list_5.Result, Branch01=assert_list_6.Result, Branch02=assert_8.Result, FlattenInputs=True)  # -> flatten(Result)
entwine_6 = Entwine(Branch00=assert_9.Result, Branch01=assert_11.Result, FlattenInputs=True)  # -> flatten(Result)
emphasis_2 = Emphasis(Text="Test")
strike_2 = Strike(Text="Test")
panel_33 = Panel("Emphasis")
panel_34 = Panel("Strike")
# Manually check report file
panel_35 = Panel("ReportExample.md")
# Report
create_report = CreateReport(ReportParts=[emphasis_2, strike_2], Title="Report", TableOfContents=Toggle(True))
concat_3 = Concatenate(FragmentA=path, FragmentB=panel_35)
panel_36 = Panel(create_report)
path_4 = FilePath(concat_3)
txt_19 = Text("""# Report
[TOC]
*Test*
~~Test~~""")
save_report = SaveReport(Report=create_report, Path=path_4)
assert_12 = Assert(TestNames="Create Report", Expected=txt_19, Actual=create_report)  # -> Result, FailedInfo
panel_37 = Panel(txt_19)
entwine_7 = Entwine(Branch00=assert_12.Result, FlattenInputs=True)  # -> flatten(Result)
flowchart_start_node = FlowchartStartNode(Text="First", Shape=0)
panel_38 = Panel("""Category 1
Category 2
Category 3""")
panel_39 = Panel("""0.23
0.66
1.45""")
flowchart_link = FlowchartLink(Type="2", Node=flowchart_start_node, Text="Sample text")
flowchart_start_node_2 = FlowchartStartNode(Text="First Node", Shape=0)
flowchart_start_node_3 = FlowchartStartNode(Text="First Node", Shape=0)
flowchart_start_node_4 = FlowchartStartNode(Text="First", Shape=Slider(3, range=0..10))
flowchart_start_node_5 = FlowchartStartNode(Text="First", Shape=0)
flowchart_link_2 = FlowchartLink(Type="1", Node=flowchart_start_node_3, Text="My Link")
pie_chart = PieChart(Title="Title of chart", Categories=panel_38, Values=panel_39)
txt_20 = Text("""```mermaid
pie title Title of chart
    "Category 1" : 0.23
    "Category 2" : 0.66
    "Category 3" : 1.45
```""")
flowchart_node = FlowchartNode(Text="Second", NodeLink=flowchart_start_node, Shape=0)
flowchart_node_2 = FlowchartNode(Text="Third", NodeLink=flowchart_start_node, Shape=0)
flowchart_node_3 = FlowchartNode(Text="Fourth", NodeLink=flowchart_start_node, Shape=0)
flowchart_node_4 = FlowchartNode(Text="Sixth", NodeLink=flowchart_link, Shape="8")
flowchart_node_5 = FlowchartNode(Text="Second Node", NodeLink=flowchart_start_node_2, Shape=0)
flowchart_node_6 = FlowchartNode(Text="Second Node", NodeLink=flowchart_link_2, Shape=0)
flowchart_node_7 = FlowchartNode(Text="Second", NodeLink=flowchart_start_node_4, Shape=Slider(5, range=0..10))
flowchart_node_8 = FlowchartNode(Text="First", NodeLink=flowchart_start_node_5, Shape=0)
# Tools
panel_40 = Panel("Pie Chart")
panel_41 = Panel(txt_20)
assert_13 = Assert(TestNames=panel_40, Expected=txt_20, Actual=pie_chart)  # -> Result, FailedInfo
flowchart = Flowchart(Direction=Toggle(True), LastNodes=flowchart_node_5)
flowchart_2 = Flowchart(Direction=Toggle(True), LastNodes=flowchart_node_6)
flowchart_3 = Flowchart(Direction=Toggle(True), LastNodes=flowchart_node_7)
flowchart_4 = Flowchart(Direction=Toggle(True), LastNodes=flowchart_node_8)
flowchart_node_9 = FlowchartNode(Text="Fifth", NodeLink=[flowchart_node, flowchart_node_2, flowchart_node_3], Shape=0)
txt_21 = Text("""```mermaid
graph LR
First_Node --> Second_Node
```""")
txt_22 = Text("""```mermaid
graph LR
First_Node -- My Link --- Second_Node
```""")
txt_23 = Text("""```mermaid
graph LR
First[[First]] --> Second((Second))
```""")
txt_24 = Text("""```mermaid
graph LR
First --> First
```""")
panel_42 = Panel(txt_22)
panel_43 = Panel(txt_21)
panel_44 = Panel(txt_23)
panel_45 = Panel(txt_24)
assert_14 = Assert(TestNames="Simple flowchart", Expected=txt_21, Actual=flowchart)  # -> Result, FailedInfo
assert_15 = Assert(TestNames="Simple flowchart with link", Expected=txt_22, Actual=flowchart_2)  # -> Result, FailedInfo
assert_16 = Assert(TestNames="Different shapes", Expected=txt_23, Actual=flowchart_3)  # -> Result, FailedInfo
assert_17 = Assert(TestNames="Self pointing node", Expected=txt_24, Actual=flowchart_4)  # -> Result, FailedInfo
flowchart_5 = Flowchart(Direction=Toggle(True), LastNodes=[flowchart_node_9, flowchart_node_4])
txt_25 = Text("""```mermaid
graph LR
First --> Second
Second --> Fifth
First --> Third
Third --> Fifth
First --> Fourth
Fourth --> Fifth
First -. Sample text .-> Sixth{Sixth}
```""")
panel_46 = Panel(txt_25)
assert_18 = Assert(TestNames="Complex flowchart", Expected=txt_25, Actual=flowchart_5)  # -> Result, FailedInfo
entwine_8 = Entwine(
    Branch00=assert_13.Result,
    Branch01=assert_14.Result,
    Branch02=assert_15.Result,
    Branch03=assert_16.Result,
    Branch04=assert_17.Result,
    Branch05=assert_18.Result,
    FlattenInputs=True)  # -> flatten(Result)
total = Total(Results=[entwine, entwine_4, entwine_3, entwine_5, entwine_6, entwine_7, entwine_8])  # -> TotalResult, ReportPart
panel_47 = Panel(total.TotalResult)
